# Grasshopper definition 200622 Voronoi Superficie.gh (Grasshopper 0.9.76)
# plug-ins: Weaverbird

crv = Curve(<curve referenced from the Rhino model>)
patch = Patch(Curves=crv, Spans=20, Flexibility=1, Trim=True)
popgeo = PopulateGeometry(Geometry=patch, Count=Slider(92, range=0..200), Seed=Slider(2, range=0..10))
bbox = BoundingBox(Content=crv, Plane=PlaneXY(0, 0, 0))  # -> Box, Box_2
voronoi³ = Voronoi3D(Points=popgeo, Box=bbox.Box)  # -> Cells, Boundary
bbx = BrepBrep(BrepA=patch, BrepB=voronoi³.Cells)  # -> Curves, Points
disc = Discontinuity(Curve=bbx.Curves, Level=1)  # -> Points, Parameters
pline = PolyLine(Vertices=disc.Points, Closed=Toggle(True))
avr = Average(Input=disc.Points)
scale = Scale(Geometry=pline, Center=avr, Factor=Slider(0.752, range=0..1))  # -> Geometry, Transform
loft = Loft(
    Curves=[scale.Geometry, pline],
    Options={Adjust=False, Closed=False, LoftEnds=0, LoftSimp=0, LoftType=0, Rebuild=10, Refit=0.01})
debrep = DeconstructBrep(Brep=loft)  # -> Faces, Edges, Vertices
mesh_uv = MeshSurface(Surface=debrep.Faces, UCount=5, VCount=5, Overhang=True, Equalize=False)  # -> flatten(Mesh)
wbjoin = WeaverbirdsJoinMeshesAndWeld(Mesh=mesh_uv, Weld=False)
wblaplace = WeaverbirdsLaplacianSmoothing(MeshCurves=wbjoin, Level=Slider(3.823, range=0..10), SmoothNakedEdges=1, Thin=1)
wbcatmullclark = WeaverbirdsCatmullClarkSubdivision(MeshCurves=wblaplace, Level=Slider(1.119, range=0..10), SmoothNakedEdges=1)
wbthicken = WeaverbirdsMeshThicken(MeshCurves=wbcatmullclark, Distance=Slider(0.601, range=0..1), OffsetType=0)
