# Grasshopper definition TA1_anillo.gh (Grasshopper 0.9.76)
# plug-ins: MeshEdit Components, Bifocals, Weaverbird

brep = Brep(<brep referenced from the Rhino model>)
panel = Panel("PASO 1")
popgeo = PopulateGeometry(Geometry=brep, Count=Slider(100, range=0..200), Seed=Slider(2, range=0..10))
bbox = BoundingBox(Content=brep, Plane=PlaneXY(0, 0, 0))  # -> Box, Box_2
voronoi³ = Voronoi3D(Points=popgeo, Box=bbox.Box)  # -> Cells, Boundary
bbx = BrepBrep(BrepA=brep, BrepB=voronoi³.Cells)  # -> Curves, Points

agujero = Slider(0.64, range=0..1)
explode = Explode(Curve=bbx.Curves, Recursive=True)  # -> Segments, Vertices
shift = ShiftList(List=explode.Vertices, Shift="-1", Wrap=Toggle(False))
avr = Average(Input=shift)
panel_2 = Panel("PASO 2")
scale = Scale(Geometry=shift, Center=avr, Factor=agujero)  # -> Geometry, Transform
shift_2 = ShiftList(List=shift, Shift="0", Wrap=True)  # -> simplify(List)
shift_3 = ShiftList(List=shift, Shift="1", Wrap=True)  # -> simplify(List)
shift_4 = ShiftList(List=scale.Geometry, Shift="0", Wrap=True)  # -> simplify(List)
shift_5 = ShiftList(List=scale.Geometry, Shift="1", Wrap=True)  # -> simplify(List)
merge = Merge(Data1=graft(shift_2), Data2=graft(shift_3), Data3=graft(shift_4), Data4=graft(shift_5))

quad = MeshQuad(CornerA=0, CornerB=1, CornerC=3, CornerD=2)
conmesh = ConstructMesh(Vertices=merge, Faces=quad)
panel_3 = Panel("PASO 3")
mjoin = MeshJoin(Meshes=flatten(conmesh))
weldvertices = MeshWeldVertices(Mesh=mjoin, Tolerance=0.01)  # -> RuntimeMessage, Mesh
unifynormals = MeshUnifyNormals(Mesh=weldvertices.Mesh)

grosor = Slider(0.36, range=0..1)
panel_4 = Panel("PASO 4")
wblaplace = WeaverbirdsLaplacianSmoothing(MeshCurves=unifynormals, Level="2", SmoothNakedEdges=1, Thin=1)
wbcatmullclark = WeaverbirdsCatmullClarkSubdivision(MeshCurves=wblaplace, Level="1", SmoothNakedEdges=1)
wbthicken = WeaverbirdsMeshThicken(MeshCurves=wbcatmullclark, Distance=grosor, OffsetType=0)
