# Grasshopper definition TA2_lampara.gh (Grasshopper 0.9.76)
# plug-ins: Pufferfish, MeshMachine, Bifocals, Millipede, Weaverbird, plankton

schwarz_g_gyroid = Panel("cos(x)*sin(y)+cos(y)*sin(z)+cos(z)*sin(x)")
π_π = Domain(Domain(-3.141592654, 3.141592654))
number_slider = Slider(21, range=0..50)
range = Range(Domain=π_π, Steps=expr("x-1", number_slider))
crossref = CrossReference(ListA=range, ListB=range, ListC=range, CrossMode=1)  # -> ListA, ListB, ListC
eval = Evaluate(F=schwarz_g_gyroid, x=crossref.ListA, y=crossref.ListB, z=crossref.ListC)
panel = Panel("PASO 2")

# ----
# NOTA. Las dimensiones del objeto final son el doble
# e.g. 12 = 24mm en Rhino
medidas = Slider(38, range=0..100)
medidas_2 = Slider(48, range=0..100)
medidas_3 = Slider(79, range=0..100)
pt = ConstructPoint(XCoordinate=expr("x-x", medidas), YCoordinate=expr("x-x", medidas_2), ZCoordinate=expr("-x", medidas_3))
box = CenterBox(Base=PlaneXY(0, 0, 0), X=medidas, Y=medidas_2, Z=medidas_3)
B = PointB(Point(0, 0, 0))
move2pt = MoveToPoint(Geometry=box, PointA=pt, PointB=B)  # -> Moved, Vector, Transform
panel_2 = Panel("PASO 1")

pt_2 = ConstructPoint(XCoordinate=crossref.ListA, YCoordinate=crossref.ListB, ZCoordinate=crossref.ListC)

iso_surface = IsoSurface(
    Box=move2pt.Moved,
    Values=eval,
    XResolution=number_slider,
    YResolution=number_slider,
    ZResolution=number_slider,
    IsoValue=Slider(0.001, range=0..0.001),
    MergeVertices=Toggle(True))
wblaplace = WeaverbirdsLaplacianSmoothing(MeshCurves=iso_surface, Level="2", SmoothNakedEdges=0, Thin=1)
panel_3 = Panel("PASO 3")

box_2 = Box(move2pt.Moved)
mesh = Mesh(wblaplace)

panel_4 = Panel("PASO 4")
arrbox = BoxArray(
    Geometry=mesh,
    Cell=box_2,
    XCount=Slider(3, range=-10..10),
    YCount=Slider(3, range=-10..10),
    ZCount=Slider(2, range=-10..10))  # -> Geometry, Transform
wbjoin = WeaverbirdsJoinMeshesAndWeld(Mesh=arrbox.Geometry, Weld=False)

brep = Brep(<brep referenced from the Rhino model>)
mesh_2 = MeshBrep(
    Brep=brep,
    Settings={GridMaxCount=0, GridMinCount=16, JaggedSeams=False, MaxEdgeLength=0, MinEdgeLength=0.0001, MinTolerance=0, Refine=True, RefineAngle=0, RelativeTolerance=0.65, SimplePlanes=True, Tolerance=0})
msplit = MeshSplit(Mesh=wbjoin, Splitters=mesh_2)  # -> reverse(Result)
item = ListItem(List=msplit, Index=0, Wrap=True)
panel_5 = Panel("PASO 5")

wbnaked = WeaverbirdsNakedBoundary(MeshClosedPolylines=item)
meshmachine = MeshMachine(
    Geometry=item,
    Length="26",
    FixCurves=wbnaked,
    Flip=1,
    PullStrength=0.8,
    CurvatureAdaptivity="0.2",
    BoundaryScale=1,
    BoundaryDistance=5,
    Reset=Toggle(True))
pmesh = PlanktonMesh(meshmachine)
panel_6 = Panel("PASO 6")

mesh_3 = Mesh(pmesh)
wbloop = WeaverbirdsLoopSubdivision(MeshCurves=mesh_3, Level="2", SmoothNakedEdges=1)
wbthicken = WeaverbirdsMeshThicken(MeshCurves=wbloop, Distance=Slider(4, range=0..10), OffsetType=0)
panel_7 = Panel("PASO 7")
