# Grasshopper definition TA3_suela.gh (Grasshopper 0.9.76)
# Copyright: ©2018 GNU General Public License
# plug-ins: MarchingCubes, Bifocals

srf = Surface(<surface referenced from the Rhino model>)
sdivide = DivideSurface(Surface=reparameterize(srf), UCount=Slider(27, range=0..50), VCount=Slider(38, range=0..50))  # -> Points, Normals, Parameters
image = ImageSampler(
    sdivide.Parameters,
    FilePath="C:\Users\Alison\Downloads\TFG\Imágenes\foot-preassure-map_bn.jpg",
    Filter="Value",
    Interpolate=False,
    Umax=1,
    Umin=0,
    Vmax=1,
    Vmin=0,
    Wrap=1)
panel = Panel("PASO 1")
multiplication = Multiplication(A=image, B=Slider(4.42, range=0..10))
cir = Circle(Plane=sdivide.Points, Radius=multiplication)
preview = CustomPreview(Geometry=cir, Shader=ColourSwatch(SwatchColor=RGBA(34, 0, 255, 63)))

crv = Curve([<curve referenced from the Rhino model> x2])
divide = DivideCurve(Curve=crv, Count=50, Kinks=False)  # -> Points, Tangents, Parameters
intcrv = Interpolate(Vertices=divide.Points, Degree=3, Periodic=False, KnotStyle=1)  # -> Curve, Length, Domain
X = UnitX(Factor="-130")
extr = Extrude(Base=intcrv.Curve, Direction=X)
srf_2 = Surface(extr)
panel_2 = Panel("PASO 2")
morph_between_surfaces = MorphBetweenSurfaces(
    surfaces=srf_2,
    voxel_number_x=Slider(14, range=0..50),
    voxel_number_y=Slider(24, range=0..50),
    voxel_number_z=Slider(2, range=1..5))

panel_3 = Panel("PASO 3")
cell_morph_value = CellMorphValue(voxels=morph_between_surfaces, points=flatten(sdivide.Points), values=flatten(image), distance_influence=Toggle(False))
crv_2 = Curve([<curve referenced from the Rhino model> x8])
crv_3 = Curve([<curve referenced from the Rhino model> x8])
tween_cell_fill = TweenCellFill(unit_cell_1=crv_3, unit_cell_2=crv_2, voxels=morph_between_surfaces, value=flatten(cell_morph_value))

unit_cell_selector = CellSelector({"Prim. Cubic": 0, "BC": 1, "BC Cubic": 2, "FC Cubic": 3, "Edge Octa.": 4, "Vertex Octa.": 5, "NaCl": 6, "Star Tet.": 7, "BC Star Tet.": 8, "Octa. Tet.": 9, "Dodecahedron": 10, "Trunc. Octa.": 11, "Tetrahedral": 12, "BC1 (tween)": 13, "BC2 (tween)": 14, "Octa. (shell)": 15, "Dodeca. (shell)": 16, "Trunc. Octa. (shell)": 17, "Gyroid (shell)": 18, "Cubic Center": 19, "Cubic Face": 20}, selected="BC")

crv_4 = Curve(<curve referenced from the Rhino model>)
panel_4 = Panel("PASO 5")
project = Project(Curve=crv_4, Brep=srf_2, Direction=Vector(0, 0, 1))
srfsplit = SurfaceSplit(Surface=srf_2, Curves=project)  # -> reverse(Fragments)
item = ListItem(List=srfsplit, Index=0, Wrap=True)
custom_mesh_settings = SettingsCustom(
    StitchSeams=True,
    SimplePlanes=False,
    Refine=True,
    MinCount=16,
    MaxCount=400,
    AspectRatio="1",
    MaxDistance=0,
    MaxAngle="180",
    MinEdge=".1",
    MaxEdge="5")
brep = Brep(item)
mesh = MeshBrep(Brep=brep, Settings=custom_mesh_settings)
medges = MeshEdges(Mesh=mesh)  # -> NakedEdges, InteriorEdges, NonManifoldEdges

cell_type = CellType(unit_cell_selector=unit_cell_selector)
crv_5 = Curve(cell_type)

brep_2 = Brep(<brep referenced from the Rhino model>)
trim_lattice = TrimLattice(geometry=brep_2, lattice=tween_cell_fill)  # -> trimmed_lattice, unrimmed_lattice
crv_6 = Curve(trim_lattice.unrimmed_lattice)
merge_curves = MergeCurves(lattice=crv_6, max_distance=Slider(1, range=0..1))
panel_5 = Panel("PASO 4")
remove_by_valence = RemoveByValence(lattice=merge_curves, valence_number="1")

panel_6 = Panel("PASO 6")
demesh = DeconstructMesh(Mesh=mesh)  # -> Vertices, Faces, Colours, Normals
morph_lattice_to_skin = MorphLatticeToSkin(lattice=remove_by_valence, geometry=mesh, max_distance="0.5", geometry_2=flatten(demesh.Vertices), max_distance_2="10")

panel_7 = Panel("EXTRA")
srf_3 = Surface(<surface referenced from the Rhino model>)
brep_charge = BrepCharge(Brep=flatten(srf_3))

panel_8 = Panel("PASO 7")
crv_7 = Curve(morph_lattice_to_skin)
curve_charge = CurveCharge(Curve=crv_7, Radius="1", ChargeStrengths=Slider(1, range=0..1))
cocoon = Cocoon(
    Charges=flatten(curve_charge),
    Iso=Slider(0.2, range=0..1),
    CellSize=Slider(0.3, range=0..1),
    Execute=Toggle(False),
    Simple=False)  # -> Mesh, RefinementData
refine = Refine(
    RefinementData=cocoon.RefinementData,
    Samples=Slider(1, range=0..10),
    SampleSize=Slider(0.15, range=0..1),
    SampleTolerance=Slider(2, range=0..2),
    LaplacianSmoothing=Slider(1, range=0..10),
    ValencePasses=Slider(1, range=0..10),
    SubD="0",
    Execute=Toggle(False))

# ==== cluster MorphBetweenSurfaces: Conformal fill of voxels between two or more surfaces

surfaces = ClusterInput()  # At least 2 surfaces to morph voxels between
voxel_number_x = ClusterInput()  # Number of Voxels in the X direction
voxel_number_y = ClusterInput()  # Number of Voxels in the Y direction
voxel_number_z = ClusterInput()  # Number of Voxels in the Z direction
srf = Surface(flatten(surfaces))
num = Number(voxel_number_z)
num_2 = Number(voxel_number_x)
num_3 = Number(voxel_number_y)
sdivide = DivideSurface(Surface=srf, UCount="30", VCount="30")  # -> simplify(Points), Normals, Parameters
pshift = ShiftPaths(Data=sdivide.Points, Offset="-1")
# CRYSTALLON V1.0 -- Lattice structure tools for Grasshopper3D
# 
# Copyright (C) 2018  Aaron Porterfield
# 
# www.studiofathom.com
# www.fequalsf.com
# 
#     This program is free software: you can redistribute it and/or modify
#     it under the terms of the GNU General Public License as published by
#     the Free Software Foundation, either version 3 of the License, or any later version.
# 
#     This program is distributed in the hope that it will be useful,
#     but WITHOUT ANY WARRANTY; without even the implied warranty of
#     MERCHANTABILITY or FITNESS FOR A PARTICULAR PURPOSE.  See the
#     GNU General Public License for more details.
# 
#     You should have received a copy of the GNU General Public License
#     along with this program.  If not, see <http://www.gnu.org/licenses/>.
panel = Panel("MORPH BETWEEN SURFACES")
flip = FlipMatrix(Data=pshift)
dom = ConstructDomain(DomainStart=0, DomainEnd=1)
pline = PolyLine(Vertices=flip, Closed=False)
range = Range(Domain=dom, Steps=num)
eval = EvaluateCurve(Curve=reparameterize(pline), Parameter=range)  # -> Point, Tangent, Angle
flip_2 = FlipMatrix(Data=eval.Point)
addition = Addition(A="30", B="1")
srfgrid = SurfaceFromPoints(Points=flip_2, UCount=graft(addition), Interpolate=False)  # -> flatten(Surface)
toggle = BooleanToggle(False)
shift = ShiftList(List=srfgrid, Shift="1", Wrap=toggle)
shift_2 = ShiftList(List=srfgrid, Shift="-1", Wrap=toggle)
divide = DivideDomain²(Domain=shift, UCount=num_2, VCount=num_3)
divide_2 = DivideDomain²(Domain=shift_2, UCount=num_2, VCount=num_3)
blendbox = BlendBox(SurfaceA=graft(shift), DomainA=divide, SurfaceB=graft(shift_2), DomainB=divide_2)  # -> flatten(TwistedBox)
voxels = ClusterOutput(blendbox)  # Voxels to be filled with unit cells

# ==== cluster CellMorphValue: Morph unit cells with a point cloud and corrosponding values

distance_influence = ClusterInput()  # If true the distance between the points and voxels will affect the magnitude
influence = ClusterInput()  # Smoothed range of attractor influence (0-1)
values = ClusterInput()  # Values that correspond to points (flattened)
points = ClusterInput()  # List of points (flattened)
voxels = ClusterInput()  # Voxels to be filled with unit cells
brep = Brep(voxels)
num = Number(values)
pt = Point(points)
area = Area(Geometry=flatten(brep))  # -> Area, Centroid
cp = ClosestPoint(Point=area.Centroid, Cloud=pt)  # -> ClosestPoint, CPIndex, Distance
item = ListItem(List=num, Index=cp.CPIndex, Wrap=True)
panel = Panel("CELL MORPH VALUE")
expression = Expression(x=influence, y=cp.Distance, Expression="-1*e^(-x*y)")
bnd = Bounds(Numbers=item)
remap = RemapNumbers(Value=item, Source=bnd, Target=Domain(0, 1))  # -> Mapped, Clipped
bnd_2 = Bounds(Numbers=expression)
not = GateNot(A=distance_influence)
remap_2 = RemapNumbers(Value=expression, Source=bnd_2, Target="1 to 0")  # -> Mapped, Clipped
cull = CullPattern(List=remap.Mapped, CullPattern=not)
multiplication = Multiplication(A=remap.Mapped, B=remap_2.Mapped)
cull_2 = CullPattern(List=multiplication, CullPattern=distance_influence)
num_2 = Number([cull_2, cull])
value = ClusterOutput(num_2)  # Values (0-1) for morph

# ==== cluster TweenCellFill: Fill voxels with morphed unit cells

unit_cell_1 = ClusterInput()  # Unit cell to populate voxels
unit_cell_2 = ClusterInput()  # Unit cell to populate voxels
value = ClusterInput()  # Value from 0-1 corresponding to each voxel
voxels = ClusterInput()  # Voxels to be filled with unit cells
num = Number(value)
flip = FlipCurve(Curve=unit_cell_1, Guide=unit_cell_2)  # -> Curve, Flag
tweencrv = TweenCurve(CurveA=flip.Curve, CurveB=unit_cell_2, Factor=graft(num), BlendType=0)
panel = Panel("TWEEN CELL FILL")
bbox = BoundingBox(Content=tweencrv, Plane=PlaneXY(0, 0, 0), UnionBox=True)  # -> Box, Box_2
morph = BoxMorph(Geometry=tweencrv, Reference=bbox.Box, Target=graft(voxels))  # -> flatten(Geometry)
line = Line(morph)

topoly = CurveToPolyline(Curve=morph, ToleranceDistance=0, ToleranceAngle=0)  # -> Polyline, Segments
line_2 = Line(topoly.Polyline)

remove_duplicate_lines = RemoveDuplicateLines(lattice_l=flatten(line_2))
lattice = ClusterOutput(remove_duplicate_lines)  # List of curves that make up the lattice

# ==== cluster TrimLattice: Trim lattice with a closed volume

geometry = ClusterInput()  # Geometry to trim with (closed brep or mesh)
lattice = ClusterInput()  # Lattice curves to trim
geo = Geometry(geometry)
crv = Curve(lattice)
mesh = Mesh(geo)
mcx = MeshCurve(Mesh=mesh, Curve=crv)  # -> Points, Faces
null = NullItem(Item=mcx.Points)  # -> NullFlags, InvalidFlags, Description
crv_cp = CurveClosestPoint(Point=mcx.Points, Curve=graft(crv))  # -> Point, Parameter, Distance
panel = Panel("TRIM LATTICE")
cull = CullPattern(List=graft(crv), CullPattern=null.NullFlags)
shatter = Shatter(Curve=graft(crv), Parameters=crv_cp.Parameter)
curvepoint = PointOnCurve(cull, parameter=0.5)
curvepoint_2 = PointOnCurve(shatter, parameter=0.5)
minc = MeshInclusion(Mesh=mesh, Point=curvepoint, Strict=False)
minc_2 = MeshInclusion(Mesh=mesh, Point=curvepoint_2, Strict=False)
cull_2 = CullPattern(List=shatter, CullPattern=minc_2)
cull_3 = CullPattern(List=cull, CullPattern=minc)
crv_2 = Curve(flatten(cull_2))
crv_3 = Curve(flatten(cull_3))
unrimmed_lattice = ClusterOutput(crv_3)  # Lattice curves that have not been trimmed (Typically removes curves with valence 1)
trimmed_lattice = ClusterOutput(crv_2)  # Lattice curves that have been trimmed

# ==== cluster MorphLatticeToSkin: Morph lattice to connect to skin

geometry = ClusterInput()  # Geometry to morph to
lattice = ClusterInput()  # Lattice to morph to skin
geometry_2 = ClusterInput()  # Geometry to morph to
max_distance = ClusterInput()  # Maximum distance from geometry
max_distance_2 = ClusterInput()  # Maximum distance to moprh
geo = Geometry(geometry_2)
crv = Curve(lattice)
geo_2 = Geometry(geometry)
cp = ControlPoints(Curve=crv)  # -> simplify(Points), Weights, Knots
pull = PullPoint(Point=cp.Points, Geometry=geo_2, ClosestOnly=True)  # -> ClosestPoint, Distance
smaller = SmallerThan(FirstNumber=pull.Distance, SecondNumber=max_distance)  # -> SmallerThan, OrEqualTo
not = GateNot(A=smaller.SmallerThan)
cull = CullPattern(List=cp.Points, CullPattern=smaller.SmallerThan)
cull_2 = CullPattern(List=cp.Points, CullPattern=not)  # -> simplify(List)
pull_2 = PullPoint(Point=cull, Geometry=geo, ClosestOnly=True)  # -> simplify(ClosestPoint), simplify(Distance)
smaller_2 = SmallerThan(FirstNumber=pull_2.Distance, SecondNumber=max_distance_2)  # -> SmallerThan, OrEqualTo
not_2 = GateNot(A=smaller_2.SmallerThan)
panel = Panel("MORPH TO SKIN")
cull_3 = CullPattern(List=pull_2.ClosestPoint, CullPattern=smaller_2.SmallerThan)  # -> simplify(List)
cull_4 = CullPattern(List=cull, CullPattern=not_2)  # -> simplify(List)
merge = Merge(Data1=cull_2, Data2=cull_4, Data3=cull_3)
item = ListItem(List=merge, Index=0, Wrap=True)  # -> Item1, Item, Item1_2
ln = Line(StartPoint=item.Item1, EndPoint=item.Item)
remove_duplicate_lines = RemoveDuplicateLines(lattice_l=flatten(ln))
len = Length(Curve=remove_duplicate_lines)
larger = LargerThan(FirstNumber=len, SecondNumber=0)  # -> LargerThan, OrEqualTo
cull_5 = CullPattern(List=remove_duplicate_lines, CullPattern=larger.LargerThan)
crv_2 = Curve(cull_5)
lattice_2 = ClusterOutput(crv_2)  # Morphed lattice

# ==== cluster RemoveByValence: Remove curves by number of connections

lattice = ClusterInput()  # Lattice curves to filter
valence_number = ClusterInput()  # The number of connections each curve has
crv = Curve(lattice)
cp = ControlPoints(Curve=crv)  # -> Points, Weights, Knots
cps = ClosestPoints(Point=cp.Points, Cloud=flatten(cp.Points), Count=expr("x+1", valence_number))  # -> ClosestPoint, CPIndex, simplify(Distance)
panel = Panel("REMOVE BY VALENCE")
trim = TrimTree(Tree=cps.Distance, Depth=1)
ma = MassAddition(Input=trim)  # -> Result, PartialResults
smaller = SmallerThan(FirstNumber=ma.Result, SecondNumber="0")  # -> SmallerThan, OrEqualTo
cull = CullPattern(List=graft(crv), CullPattern=smaller.OrEqualTo)  # -> flatten(List)
lattice_2 = ClusterOutput(cull)  # Filtered lattice

# ==== cluster MergeCurves: Merge endpoints of curves by distance.

max_distance = ClusterInput()  # Maximum distance to merge
lattice = ClusterInput()  # Lattice to merge
crv = Curve(lattice)
num = Number(max_distance)
cp = ControlPoints(Curve=crv)  # -> Points, Weights, Knots
cullpt = CullDuplicates(Points=flatten(cp.Points), Tolerance=num, CullMode=3)  # -> Points, Indices, Valence
fsim = FindSimilarMember(Data=cp.Points, Set=cullpt.Points)  # -> Hit, Index
panel = Panel("MERGE CURVES")
pline = PolyLine(Vertices=fsim.Hit, Closed=False)  # -> flatten(Polyline)
len = Length(Curve=pline)
larger = LargerThan(FirstNumber=len, SecondNumber="0")  # -> LargerThan, OrEqualTo
cull = CullPattern(List=pline, CullPattern=larger.LargerThan)
lattice_2 = ClusterOutput(cull)  # Merged lattice

# ==== cluster CellType: Preset unit cells

crv = Curve([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])
crv_2 = Curve([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])
crv_3 = Curve([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])
crv_4 = Curve([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])
crv_5 = Curve([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])
crv_6 = Curve([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])
crv_7 = Curve([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])
crv_8 = Curve([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])
crv_9 = Curve([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])
crv_10 = Curve([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])
crv_11 = Curve([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])
crv_12 = Curve([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])
crv_13 = Curve([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])
crv_14 = Curve([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])
crv_15 = Curve([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])
mesh = Mesh(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)
mesh_2 = Mesh(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)
mesh_3 = Mesh(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)
mesh_4 = Mesh(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)
mesh_5 = Mesh(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)
mesh_6 = Mesh(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)
entwine = Entwine(
    Branch00=crv_6,
    Branch01=crv_10,
    Branch02=crv_13,
    Branch03=crv_4,
    Branch04=crv_2,
    Branch05=crv_8,
    Branch06=crv_11,
    Branch07=crv,
    Branch08=crv_7,
    Branch09=crv_9,
    Branch010=crv_12,
    Branch011=crv_3,
    Branch012=crv_5,
    Branch013=crv_14,
    Branch014=crv_15,
    Branch015=mesh,
    Branch016=mesh_2,
    Branch017=mesh_3,
    Branch018=mesh_4,
    Branch019=mesh_5,
    Branch020=mesh_6,
    FlattenInputs=True)  # -> simplify(Result)
unit_cell_selector = ClusterInput()
branch = TreeBranch(Tree=entwine, Path=unit_cell_selector, MaintainPaths=True)
unit_cell = ClusterOutput(branch)  # Single unit cell to populate voxels

# ==== cluster RemoveDuplicateLines
lattice_l = ClusterInput()
crv = Curve(lattice_l)
curvepoint = PointOnCurve(crv, parameter=0.5)
cullpt = CullDuplicates(Points=curvepoint, Tolerance=".001", CullMode=1)  # -> Points, Indices, Valence
item = ListItem(List=crv, Index=cullpt.Indices, Wrap=True)
lattice = ClusterOutput(item)
