# Grasshopper definition TB1_voronoi.gh (Grasshopper 0.9.76)
# plug-ins: Bifocals

panel = Panel("PASO 1")
R = Region({Plane=Plane(origin=(-35.43688043, -34.28947279, 0), x=(0, 1, 0), y=(1, 0, 0)), X=Domain(0, 65.26278696), Y=Domain(0, 71.02126816), Z=Domain(-66.03565292, 0)})
pop3d = Populate3D(Region=R, Count=Slider(16, range=0..20), Seed=Slider(3, range=0..10))
voronoi³ = Voronoi3D(Points=pop3d, Box=R)  # -> Cells, Boundary

panel_2 = Panel("PASO 2")
edges = BrepEdges(Brep=voronoi³.Cells)  # -> Naked, Interior, NonManifold
pipe = Pipe(Curve=edges.Interior, Radius=Slider(0.67, range=0..1), Caps=2)
