# Grasshopper definition TB2_gyroid.gh (Grasshopper 0.9.76)
# plug-ins: Bifocals, Millipede, Weaverbird

p_w_hybrid = Panel("10*(cos(x)*cos(y))+(cos(y)*cos(z))+(cos(z)*cos(x))-0.01*(cos(x)*cos(y)*cos(z))")
scherk_s_surface_1 = Panel("exp(z)*cos(x)-cos(y)")
scherk_s_surface_2 = Panel("sin(z+pi/2)-sinh(x)*sinh(y)")
neovius = Panel("3*(cos(x)+cos(y)+cos(z))+4*cos(x)*cos(y)*cos(z)")
schoen_iwp = Panel("(cos(x)*cos(y))+(cos(y)*cos(z))+(cos(z)*cos(x))-(cos(x)*cos(y)*cos(z))")
π_π = Domain(Domain(-3.141592654, 3.141592654))
schwarz_g_gyroid = Panel("cos(x)*sin(y)+cos(y)*sin(z)+cos(z)*sin(x)")

number_slider = Slider(21, range=0..50)
panel = Panel("PASO 2")
range = Range(Domain=π_π, Steps=expr("x-1", number_slider))
crossref = CrossReference(ListA=range, ListB=range, ListC=range, CrossMode=1)  # -> ListA, ListB, ListC
eval = Evaluate(F=schwarz_g_gyroid, x=crossref.ListA, y=crossref.ListB, z=crossref.ListC)

schwarz_p = Panel("cos(x)+cos(y)+cos(z)")
schwarz_d_diamond = Panel("sin(x)*sin(y)*sin(z)*+sin(x)*cos(y)*cos(z)+cos(x)*sin(y)*cos(z)+cos(x)*cos(y)*sin(z)")
scherk_s_tower = Panel("sinh(x)*sinh(y)-sin(z)")

medidas = Slider(4.2, range=0..50)
panel_2 = Panel("PASO 1")
box = CenterBox(Base=PlaneXY(0, 0, 0), X=medidas, Y=medidas, Z=medidas)

pt = ConstructPoint(XCoordinate=crossref.ListA, YCoordinate=crossref.ListB, ZCoordinate=crossref.ListC)

iso_surface = IsoSurface(
    Box=box,
    Values=eval,
    XResolution=number_slider,
    YResolution=number_slider,
    ZResolution=number_slider,
    IsoValue=Slider(0.001, range=0..0.001),
    MergeVertices=Toggle(True))
panel_3 = Panel("PASO 3")
wblaplace = WeaverbirdsLaplacianSmoothing(MeshCurves=iso_surface, Level=Slider(14, range=0..50), SmoothNakedEdges=Slider(0, range=0..2), Thin=1)

arrbox = BoxArray(
    Geometry=wblaplace,
    Cell=box,
    XCount=Slider(3, range=-10..10),
    YCount=Slider(2, range=-10..10),
    ZCount=Slider(2, range=-10..10))  # -> Geometry, Transform
wbjoin = WeaverbirdsJoinMeshesAndWeld(Mesh=arrbox.Geometry, Weld=False)
panel_4 = Panel("PASO 4")
wbthicken = WeaverbirdsMeshThicken(MeshCurves=wbjoin, Distance=Slider(0.31, range=0..0.5), OffsetType=0)
