# Grasshopper definition TB3_reticula.gh (Grasshopper 0.9.76)
# Copyright: ©2018 GNU General Public License
# plug-ins: MarchingCubes, Bifocals

panel = Panel("PASO 1")
srf = Surface([<surface referenced from the Rhino model> x2])
morph_between_surfaces = MorphBetweenSurfaces(
    surfaces=srf,
    voxel_number_x=Slider(7, range=0..10),
    voxel_number_y=Slider(3, range=0..10),
    voxel_number_z=Slider(2, range=1..5))

crv = Curve([<curve referenced from the Rhino model> x12])
panel_2 = Panel("PASO 2")
cell_fill = CellFill(unit_cell=crv, voxels=morph_between_surfaces)

crv_2 = Curve(cell_fill)
panel_3 = Panel("PASO 3")
curve_charge = CurveCharge(Curve=crv_2, Radius="0.5", ChargeStrengths=Slider(1, range=0..1))
cocoon = Cocoon(
    Charges=flatten(curve_charge),
    Iso=Slider(0.2, range=0..1),
    CellSize=Slider(0.3, range=0..1),
    Execute=Toggle(True),
    Simple=False)  # -> Mesh, RefinementData
refine = Refine(
    RefinementData=cocoon.RefinementData,
    Samples=Slider(1, range=0..10),
    SampleSize=Slider(0.15, range=0..1),
    SampleTolerance=Slider(2, range=0..2),
    LaplacianSmoothing=Slider(1, range=0..10),
    ValencePasses=Slider(1, range=0..10),
    SubD="0",
    Execute=Toggle(True))

# ==== cluster CellFill: Fill voxels with unit cells

unit_cell = ClusterInput()  # Unit cell to populate voxels
voxels = ClusterInput()  # Voxels to be filled with unit cells
crv = Curve(unit_cell)
bbox = BoundingBox(Content=crv, Plane=PlaneXY(0, 0, 0), UnionBox=True)  # -> Box, Box_2
# CRYSTALLON V1.0 -- Lattice structure tools for Grasshopper3D
# 
# Copyright (C) 2018  Aaron Porterfield
# 
# www.studiofathom.com
# www.fequalsf.com
# 
#     This program is free software: you can redistribute it and/or modify
#     it under the terms of the GNU General Public License as published by
#     the Free Software Foundation, either version 3 of the License, or any later version.
# 
#     This program is distributed in the hope that it will be useful,
#     but WITHOUT ANY WARRANTY; without even the implied warranty of
#     MERCHANTABILITY or FITNESS FOR A PARTICULAR PURPOSE.  See the
#     GNU General Public License for more details.
# 
#     You should have received a copy of the GNU General Public License
#     along with this program.  If not, see <http://www.gnu.org/licenses/>.
panel = Panel("CELL FILL")
morph = BoxMorph(Geometry=crv, Reference=bbox.Box, Target=graft(voxels))  # -> flatten(Geometry)
remove_duplicate_lines = RemoveDuplicateLines(lattice_l=flatten(morph))
lattice = ClusterOutput(remove_duplicate_lines)  # List of curves that make up the lattice

# ==== cluster MorphBetweenSurfaces: Conformal fill of voxels between two or more surfaces

surfaces = ClusterInput()  # At least 2 surfaces to morph voxels between
voxel_number_x = ClusterInput()  # Number of Voxels in the X direction
voxel_number_y = ClusterInput()  # Number of Voxels in the Y direction
voxel_number_z = ClusterInput()  # Number of Voxels in the Z direction
srf = Surface(flatten(surfaces))
num = Number(voxel_number_z)
num_2 = Number(voxel_number_x)
num_3 = Number(voxel_number_y)
sdivide = DivideSurface(Surface=srf, UCount="30", VCount="30")  # -> simplify(Points), Normals, Parameters
pshift = ShiftPaths(Data=sdivide.Points, Offset="-1")
panel = Panel("MORPH BETWEEN SURFACES")
flip = FlipMatrix(Data=pshift)
dom = ConstructDomain(DomainStart=0, DomainEnd=1)
pline = PolyLine(Vertices=flip, Closed=False)
range = Range(Domain=dom, Steps=num)
eval = EvaluateCurve(Curve=reparameterize(pline), Parameter=range)  # -> Point, Tangent, Angle
flip_2 = FlipMatrix(Data=eval.Point)
addition = Addition(A="30", B="1")
srfgrid = SurfaceFromPoints(Points=flip_2, UCount=graft(addition), Interpolate=False)  # -> flatten(Surface)
toggle = BooleanToggle(False)
shift = ShiftList(List=srfgrid, Shift="1", Wrap=toggle)
shift_2 = ShiftList(List=srfgrid, Shift="-1", Wrap=toggle)
divide = DivideDomain²(Domain=shift, UCount=num_2, VCount=num_3)
divide_2 = DivideDomain²(Domain=shift_2, UCount=num_2, VCount=num_3)
blendbox = BlendBox(SurfaceA=graft(shift), DomainA=divide, SurfaceB=graft(shift_2), DomainB=divide_2)  # -> flatten(TwistedBox)
voxels = ClusterOutput(blendbox)  # Voxels to be filled with unit cells

# ==== cluster RemoveDuplicateLines
lattice_l = ClusterInput()
crv = Curve(lattice_l)
curvepoint = PointOnCurve(crv, parameter=0.5)
cullpt = CullDuplicates(Points=curvepoint, Tolerance=".001", CullMode=1)  # -> Points, Indices, Valence
item = ListItem(List=crv, Index=cullpt.Indices, Wrap=True)
lattice = ClusterOutput(item)
